# Grasshopper definition GCodeToolsSample.gh (Grasshopper 1.0.7)
# plug-ins: ScriptParasite, Wombat

number_slider = Slider(0.3, range=0..1)  # disabled
unit_z = UnitZ(Factor=1)  # disabled
mesh = Mesh(<mesh referenced from the Rhino model>)  # disabled
contour = Contour(Shape=mesh, Point=Point(0, 0, 0), Direction=unit_z, Distance=number_slider)  # disabled
number_slider_2 = Slider(0.01, range=0..0.01)  # disabled
join_curves = JoinCurves(Curves=contour, Preserve=False)  # -> flatten(Curves); disabled
reduce = Reduce(Polyline=join_curves, Tolerance=number_slider_2)  # -> Polyline, Reduction; disabled
dispatch = Dispatch(List=reduce.Polyline, DispatchPattern=[True, False])  # -> ListA, ListB; disabled
list_length = ListLength(List=reduce.Polyline)  # disabled
subtraction = Subtraction(A=list_length, B=1)  # disabled
flip_curve = FlipCurve(Curve=dispatch.ListB)  # -> Curve, Flag; disabled
number_slider_3 = Slider(1, range=0..1)  # disabled
number_slider_4 = Slider(0, range=0..100)  # disabled
weave = Weave(Pattern=[0, 1], Stream0=dispatch.ListA, Stream1=flip_curve.Curve, NullGaps=False)  # disabled
shift_list = ShiftList(List=weave, Shift=1, Wrap=True)  # disabled
repeat_data = RepeatData(Data=number_slider_4, Length=list_length)  # disabled
repeat_data_2 = RepeatData(Data=number_slider_3, Length=subtraction)  # disabled
end_points = EndPoints(Curve=weave)  # -> Start, End; disabled
end_points_2 = EndPoints(Curve=shift_list)  # -> Start, End; disabled
weave_2 = Weave(Pattern=[0, 1], Stream0=repeat_data, Stream1=repeat_data_2, NullGaps=False)  # -> simplify(graft(Weave)); disabled
line = Line(StartPoint=end_points.End, EndPoint=end_points_2.Start)  # disabled
panel = Panel("-1")  # disabled
cull_index = CullIndex(List=line, Indices=panel, Wrap=True)  # -> flatten(List); disabled
weave_3 = Weave(Pattern=[0, 1], Stream0=weave, Stream1=cull_index, NullGaps=False)  # -> simplify(graft(Weave)); disabled
explode = Explode(Curve=weave_3, Recursive=True)  # -> simplify(Segments), Vertices; disabled
list_length_2 = ListLength(List=explode.Segments)  # -> simplify(Length); disabled
flatten_tree = FlattenTree(Tree=explode.Segments, Path="{0}")  # disabled
number_slider_5 = Slider(31.9, range=0..100)  # disabled
length = Length(Curve=flatten_tree)  # disabled

# ---- group: isTravel
repeat_data_3 = RepeatData(Data=weave_2, Length=list_length_2)  # -> flatten(Data); disabled

# ---- group: eval
division = Division(A=length, B=number_slider_5)  # disabled

# ---- group: paths
line_2 = Line(flatten_tree)  # disabled

# ---- group: Path to .gcode
file_path = FilePath("C:\Users\ATSmi\OneDrive\Documents\CITA\6B\Prototype2Skin\5VBox_Top_0.3mm_PETG_MK3S_1h18m.gcode")

# ----
panel_2 = Panel("C:\Users\ATSmi\source\repos\GHParasite_GCode_00")  # disabled
boolean_toggle = BooleanToggle(True)  # disabled
read_file = ReadFile(File=file_path, PerLineParse=True)
deconstruct_gcode = CSharpScript(gCode=read_file, Reference="C:\Users\ATSmi\source\repos\GCodeObjectClass\bin\Debug\GCodeObjectClass.dll")  # -> out, paths, isTravel, fValues, eValues, linesIndex; inputs gCode: list of String
# ---------- deconstruct_gcode: C# usings ----------
using System.Linq;
using GCodeObjectClass;
# ---------- deconstruct_gcode: C# ----------
    //Construct GCodeLine Objects from .gcode strings
    GCodeLine[] test01 = new GCodeLine[gCode.Count];
    for (int i = 0; i < gCode.Count; i++)
    {
      test01[i] = new GCodeLine(gCode[i]);
    }

    //Construct GCode Object
    GCode g01 = new GCode(test01);

    //lists for collecting output data from g01 GCodeLines (where HasPt = true)
    List<Point3d> pts = new List<Point3d>();
    List<Line> glines = new List<Line>();
    List<bool> gIsTravels = new List<bool>();
    List<bool> gIsExtruding = new List<bool>();
    List<double> eVals = new List<double>();
    List<double> fVals = new List<double>();
    List<int> gIndex = new List<int>();
    List<double> eValsShifted = new List<double>();
    List<double> fValsShifted = new List<double>();
    List<int> gIndexShifted = new List<int>();
    //Populate lists with data from g01 GCodeLines (where HasPt = true)
    for (int i = 0; i < g01.Length; i++)
    {
      if (g01.Lines[i].HasPt)
      {
        Point3d pt = new Point3d(g01.Lines[i].X, g01.Lines[i].Y, g01.Lines[i].Z);
        pts.Add(pt);
        gIsExtruding.Add(g01.Lines[i].IsExtruding);
        eVals.Add(g01.Lines[i].E);
        fVals.Add(g01.Lines[i].F);
        gIndex.Add(g01.Lines[i].Index);
      }
    }
    //Generate list of lines from valid points in GCode g01
    for (int i = 0; i < (pts.Count - 1); i++)
    {
      Line ln = new Line(pts[i], pts[i + 1]);
      glines.Add(ln);
      bool iT = false;
      if (gIsExtruding[i + 1] == true)
      {
        iT = false;
      }
      else
      {
        iT = true;
      }
      gIsTravels.Add(iT);
      eValsShifted.Add(eVals[i + 1]);
      fValsShifted.Add(fVals[i + 1]);
      gIndexShifted.Add(gIndex[i + 1]);
    }

    //Outputs
    paths = glines;
    isTravel = gIsTravels;
    eValues = eValsShifted;
    fValues = fValsShifted;
    linesIndex = gIndexShifted;
# ---------- end deconstruct_gcode ----------
script_parasite = ScriptParasite(Enable=boolean_toggle, Folder=panel_2)  # disabled

rectangle = Rectangle(Plane=PlaneXY(0, 0, 0), XSize=Slider(250, range=0..1000), YSize=Slider(210, range=0..1000), Radius=0)  # -> Rectangle, Length
number_slider_6 = Slider(600, range=0..1000)  # disabled
rectangle_2 = Rectangle(rectangle.Rectangle)
custom_preview = CustomPreview(
    Geometry=rectangle_2,
    Material={diffuse=RGB(221, 160, 221), emission=RGB(66, 48, 66), shine=0.5, specular=RGB(255, 255, 255), transparency=0})
list_length_3 = ListLength(List=deconstruct_gcode.paths)
button = Button()  # disabled
file_path_2 = FilePath("C:\Users\ATSmi\Desktop\dragoncurve3d_2.gcode")  # disabled
multiplication = Multiplication(A=Slider(680000, range=0..1000000), B=2)
series = Series(Start=0, Step=1, Count=list_length_3)
split_list = SplitList(List=series, Index=multiplication)  # -> ListA, ListB
list_item = ListItem(List=deconstruct_gcode.paths, Index=split_list.ListA, Wrap=True)
list_item_2 = ListItem(List=deconstruct_gcode.isTravel, Index=split_list.ListA, Wrap=True)
list_item_3 = ListItem(List=deconstruct_gcode.fValues, Index=split_list.ListA, Wrap=True)
list_item_4 = ListItem(List=deconstruct_gcode.eValues, Index=split_list.ListA, Wrap=True)
gate_not = GateNot(A=list_item_2)
cull_pattern = CullPattern(List=list_item, CullPattern=list_item_2)
cull_pattern_2 = CullPattern(List=list_item, CullPattern=gate_not)
cull_pattern_3 = CullPattern(List=list_item_3, CullPattern=gate_not)
cull_pattern_4 = CullPattern(List=list_item_4, CullPattern=gate_not)
number = Number(cull_pattern_3)
number_2 = Number(cull_pattern_4)
bounds = Bounds(Numbers=number_2)
bounds_2 = Bounds(Numbers=number)
deconstruct_domain = DeconstructDomain(Domain=bounds)  # -> Start, End
deconstruct_domain_2 = DeconstructDomain(Domain=bounds_2)  # -> Start, End
gradient = Gradient(
    LowerLimit=deconstruct_domain_2.Start,
    UpperLimit=deconstruct_domain_2.End,
    Parameter=number,
    stops=[0: RGB(0, 98, 0), 0.25: RGB(81, 175, 17), 0.5: RGB(159, 198, 146), 0.75: RGB(170, 235, 41), 1: RGB(221, 255, 53)])
gradient_2 = Gradient(
    LowerLimit=deconstruct_domain.Start,
    UpperLimit=deconstruct_domain.End,
    Parameter=number_2,
    stops=[0: RGB(234, 38, 0), 0.224: RGB(234, 126, 0), 0.509: RGB(254, 244, 84), 0.778: RGB(173, 203, 249), 1: RGB(75, 107, 169)])
custom_preview_2 = CustomPreview(Geometry=cull_pattern, Material=ColourSwatch(SwatchColor=RGB(255, 255, 255)))
custom_preview_3 = CustomPreview(Geometry=cull_pattern_2, Material=ColourSwatch(SwatchColor=RGB(255, 0, 0)))
custom_preview_4 = CustomPreview(Geometry=cull_pattern_2, Material=gradient)
custom_preview_5 = CustomPreview(Geometry=cull_pattern_2, Material=gradient_2)

panel_3 = Panel("C:\Users\ATSmi\source\repos\GHParasite_GCode_00")  # disabled
boolean_toggle_2 = BooleanToggle(True)  # disabled
file_path_3 = FilePath("C:\Users\ATSmi\OneDrive\Documents\CITA\6B\Prototype2Skin\GenerateGCode\GenerateGCode_Settings_01.txt")  # disabled
script_parasite_2 = ScriptParasite(Enable=boolean_toggle_2, Folder=panel_3)  # disabled

read_file_2 = ReadFile(File=file_path_3, PerLineParse=True)  # disabled

construct_gcode = CSharpScript(
    settings=read_file_2,
    paths=line_2,
    isTravel=repeat_data_3,
    fValues=number_slider_6,
    eValues=division,
    Reference="C:\Users\ATSmi\OneDrive\Documents\CITA\6B\Prototype2Skin\GCodeInterpreter\GCodeObjectClass.dll")  # -> out, gCode; inputs settings: list of String, paths: list of Line, isTravel: list of Boolean, fValues: list of Int32, eValues: list of Double; disabled
# ---------- construct_gcode: C# ----------
    //Sanity
    if (settings[0] != ";START")
    {
      Component.AddRuntimeMessage(GH_RuntimeMessageLevel.Warning, "Settings Start Format is Incorrect");
      return;
    }
    if (isTravel.Count != paths.Count ||  isTravel.Count != eValues.Count)
    {
      Component.AddRuntimeMessage(GH_RuntimeMessageLevel.Warning, "paths, isTravel, and eValues do not have matching data structure and count");
    }

    //Construct Start and End Lines of GCode 
    List <GCodeLine> startLines = new List<GCodeLine>();
    List <GCodeLine> middleLines = new List<GCodeLine>();
    List<GCodeLine> endLines = new List<GCodeLine>();
    bool isStart = true;
    for (int i = 0; i < settings.Count; i++)
    {
      if (settings[i] == ";END")
      {
        isStart = false;
        i++;
      }
      else if (isStart)
      {
        startLines.Add(new GCodeLine(settings[i]));
      }
      else
      {
        endLines.Add(new GCodeLine(settings[i]));
      }
    }

    if (fValues.Count != paths.Count)
    {
      for (int i = 1; i < paths.Count; i++)
      {
        fValues.Add(fValues[0]);
      }
    }

    GCode gOut = new GCode();
    for (int i = 0; i < paths.Count; i++)
    {
      GCodeLine newGcodeLine = new GCodeLine(paths[i], fValues[i], eValues[i], isTravel[i]);
      middleLines.Add(newGcodeLine);
    }
    if (startLines.Count < 1 || middleLines.Count < 1 || endLines.Count < 1)
    {
      Component.AddRuntimeMessage(GH_RuntimeMessageLevel.Error, "GCode has insuffecient commands");
      return;
    }
    else
    {
      List<GCodeLine> startMid = new List<GCodeLine>(startLines.Concat(middleLines).ToList());
      List<GCodeLine> allLines = new List<GCodeLine>(startMid.Concat(endLines).ToList());
      GCodeLine[] gLines = new GCodeLine[allLines.Count];
      for (int i = 0; i < allLines.Count; i++)
      {
        gLines[i] = allLines[i];
      }
      GCode gTemp = new GCode(gLines);
      gOut = gTemp;
    }

    //Outputs
    gCode = gOut.GetLines();
# ---------- end construct_gcode ----------

write_to_text_file = WriteToTextFile(Run=button, TextToWrite=construct_gcode.gCode, FilePath=file_path_2, Append=False, NewOnly=False)  # disabled
